# Grasshopper definition TestConnection.gh (Grasshopper 1.0.7)
# plug-ins: Robots

list = ValueList({"Bartlett-IRB120", "Bartlett-IRB1600", "Bartlett-KR6", "Bartlett-KR60-A", "Bartlett-KR60-B", "Bartlett-KR500", "Bartlett-KR60 on track", "Bartlett-UR10", "Bartlett-KR60", "Bartlett-TX200", "Bartlett-TX200L", "Bartlett-RX160", "Bartlett-RX160L"}, selected="Bartlett-IRB1600")
target = CreateTarget(Joints="pi*0.2,pi*0.5,0,0,0,0", IsCartesian=False)
target_2 = CreateTarget(Joints="0,pi*0.5,0,0,0,0", IsCartesian=False)
merge = Merge(Data1=target_2, Data2=target)
load_robot = LoadRobotSystem(Name=list, Base=PlaneXY(0, 0, 0))
program = CreateProgram(Name="DefaultProgram", RobotSystem=load_robot, Targets1=merge, StepSize=1)  # -> Program, Code, Duration, Warnings, Errors
sim = ProgramSimulation(Program=program.Program, Time=Slider(0, range=0..1), Normalized=True)  # -> SystemMeshes, JointRotations, Plane, Index, Time, Program, Errors
ue_remote = UnrealRemote(Joints=sim.Program, Port="1025", IP="127.0.0.1", Connect=Toggle(True), Play=False, Pause=False)
panel = Panel(ue_remote)
